# Grasshopper definition Portraits 2.gh (Grasshopper 1.0.7)
# plug-ins: Human

path = FilePath("C:\Users\oluwa\OneDrive\Education\IaaC_MaCAD\Projects\Module 02\S3_Digital Tools for Data Management\Homework\Homework-3_Portraits\Images\Test Image_Marilyn.jpg")
serialize_image_to_string = SerializeImageToString(ImagePath=path)
image_file = GetString(serialize_image_to_string, AtLeast=1, AtMost=1)
image_width = GetInteger(Slider(40, range=10..100), AtLeast=1, AtMost=1, Maximum=2147483647, Minimum=-2147483648)
abstraction = GetNumber(Slider(0, range=0..1), AtLeast=1, AtMost=1, Maximum=1.797693135e+308, Minimum=-1.797693135e+308)
image_height = GetInteger(Slider(50, range=10..100), AtLeast=1, AtMost=1, Maximum=2147483647, Minimum=-2147483648)
image_clarity = GetNumber(Slider(0.5, range=0.25..1), AtLeast=1, AtMost=1, Maximum=1.797693135e+308, Minimum=-1.797693135e+308)
invert_image = GetBoolean(Slider(1, range=0..1), AtLeast=1, AtMost=1, FalseValue="False", TrueValue="True")
color_mode = GetBoolean(Slider(0, range=0..1), AtLeast=1, AtMost=1, FalseValue="False", TrueValue="True")
pixels = GetBoolean(Slider(0, range=0..1), AtLeast=1, AtMost=1, FalseValue="False", TrueValue="True")
deserialize_image_from_string = DeserializeImageFromString(ImageString=image_file)

multiplication = Multiplication(A=image_width, B="5")
multiplication_2 = Multiplication(A=image_height, B="5")
multiplication_3 = Multiplication(A=multiplication, B=image_clarity)
multiplication_4 = Multiplication(A=multiplication_2, B=image_clarity)
int = Integer(multiplication_3)
int_2 = Integer(multiplication_4)
range = Range(Domain=Domain(0, 1), Steps=expr("x-1", int))
range_2 = Range(Domain=Domain(0, 1), Steps=expr("x-1", int_2))
pt = ConstructPoint(XCoordinate=range, YCoordinate=graft(range_2), ZCoordinate=0)  # -> flatten(Point)

division = Division(A=image_width, B="2")
division_2 = Division(A=image_height, B="2")
rep = ReplaceText(Text=" -x to x", Find="x", Replace=division, RecursiveReplace=False)
rep_2 = ReplaceText(Text=" -x to x", Find="x", Replace=division_2, RecursiveReplace=False)
rectangle = Rectangle(Plane=PlaneXY(0, 0, 0), XSize=rep, YSize=rep_2, Radius=0)  # -> Rectangle, Length
boundary = BoundarySurfaces(Edges=rectangle.Rectangle)  # -> reparameterize(Surfaces)
evalsrf = EvaluateSurface(Surface=boundary, Point=pt)  # -> Point, Normal, UDirection, VDirection, Frame

bnd = Bounds2D(Coordinates=pt)
dynamic_img_sampler = CSharpScript(path=deserialize_image_from_string, pt=pt, srcDom=bnd)  # -> out, A; inputs path: String, pt: list of Point3d
# ---------- dynamic_img_sampler: C# ----------
                                                      /*  Dim btmp As New Bitmap(f)
    Dim pixcolor As New Color
      Dim pixlist As New List (Of Color)
    Dim pxlpt As New On3dPoint

      For i As Integer = 0 To y.Count - 1
    pxlpt = y(i)
    Dim pxlX As Integer = CInt((btmp.Width - 1) * pxlpt.x) '+ 1
    Dim pxlY As Integer = CInt((btmp.Height - 1) * (1 - pxlpt.y)) '+ 1
    pixcolor = btmp.GetPixel(pxlX, pxlY)
    pixlist.Add(pixcolor)

    Next


      A = pixlist

*/

    Bitmap bmp = new Bitmap(path);
    List<Color> pixList = new List<Color>();
    foreach(Point3d po in pt){
      Point3d p = remap(po, srcDom);
      int pxX = (int) ((bmp.Width - 1) * p.X);
      int pxY = (int) ((bmp.Height - 1) * (1 - p.Y));
      pixList.Add(bmp.GetPixel(pxX, pxY));
    }
    A = pixList;
# ---------- dynamic_img_sampler: C# additional code ----------
  Point3d remap(Point3d p, UVInterval srcDom){
    p.X = (p.X - srcDom.U0) / (srcDom.U1 - srcDom.U0);
    p.Y = (p.Y - srcDom.V0) / (srcDom.V1 - srcDom.V0);
    return p;
  }
# ---------- end dynamic_img_sampler ----------
image_resource = ImageResource(deserialize_image_from_string)
ahsl = SplitAHSL(Colour=dynamic_img_sampler.A)  # -> Alpha, Hue, Saturation, Luminance

subtraction = Subtraction(A="1", B=ahsl.Luminance)
expression = Expression(x=ahsl.Luminance, y=abstraction, Expression="if(x>y,True,False)")
expression_2 = Expression(x=subtraction, y=abstraction, Expression="if(x>y,True,False)")
cull = CullPattern(List=evalsrf.Point, CullPattern=expression_2)
cull_2 = CullPattern(List=evalsrf.Point, CullPattern=expression)
cull_3 = CullPattern(List=ahsl.Luminance, CullPattern=expression)
cull_4 = CullPattern(List=subtraction, CullPattern=expression_2)
cull_5 = CullPattern(List=dynamic_img_sampler.A, CullPattern=expression_2)
cull_6 = CullPattern(List=dynamic_img_sampler.A, CullPattern=expression)
filter = StreamFilter(Gate=invert_image, Stream0=cull, Stream1=cull_2)
filter_2 = StreamFilter(Gate=invert_image, Stream0=cull_4, Stream1=cull_3)
filter_3 = StreamFilter(Gate=invert_image, Stream0=cull_5, Stream1=cull_6)

division_3 = Division(A=image_width, B=multiplication_3)
division_4 = Division(A=division_3, B="2")
neg = Negative(Value=division_4)
dom = ConstructDomain(DomainStart=neg, DomainEnd=division_4)
rectangle_2 = Rectangle(Plane=filter, XSize=dom, YSize=dom, Radius=0)  # -> Rectangle, Length
filter_4 = StreamFilter(Gate=color_mode, Stream0=filter_3, Stream1=ColourSwatch(SwatchColor=RGB(0, 0, 0)))
cir = Circle(Plane=filter, Radius=division_4)
filter_5 = StreamFilter(Gate=pixels, Stream0=cir, Stream1=rectangle_2.Rectangle)
scale = Scale(Geometry=filter_5, Center=filter, Factor=filter_2)  # -> Geometry, Transform
c_script = CSharpScript(crv=scale.Geometry, color=filter_4)  # -> out, A; inputs crv: Curve, color: Color
# ---------- c_script: C# ----------
    var c = color.R + "," + color.G + "," + color.B;
    crv.SetUserString("color", c);
    A = crv;
# ---------- end c_script ----------
toggle = BooleanToggle(True)
preview = CustomPreview(Geometry=c_script.A, Material=filter_4)
clean = CleanTree(RemoveNulls=toggle, RemoveInvalid=toggle, RemoveEmpty=toggle, Tree=c_script.A)

# ---- group: RH_OUT:Sphere
geo = Geometry(simplify(flatten(clean)))
